% Simulink data dictionary fan_ctrl_sf.sldd

FanMode_e = enum(DefaultValue="STANDBY", StorageType="int8")
  STANDBY = 0
  BOOST = 1
  AUTO = 2
  MANUAL = 3

FanSpd_e = enum(DefaultValue="OFF", StorageType="int8")
  OFF = 0
  LOW = 1
  MED = 2
  HIGH = 3